# Grasshopper definition CreateInterfaceComplex.gh (Grasshopper 1.0.7)
# plug-ins: GHUI

# ----
# Create Individual UI Components
panel = Panel("mySlider")
slider = CreateSlider(Name=panel, ID="mySlider", Value=50, Min=0, Max=100)
slider_2 = CreateSlider(Name="mySlider2", ID="mySlider2", Value=50, Min=0, Max=100)

# ----
# Select Where to Create the HTML UI
path = FilePath("C:\Users\pmite\Documents\GitHub\gh-web-ui\GHUI\Web UI\createdInput.html")
panel_2 = Panel(path)

# ----
# Combine UI Elements into Single Interface
concat = Concatenate(FragmentA=slider, FragmentB=slider_2)
vue_ui = BuildVueUI(HTMLPath=path, HTMLString=concat)  # -> Success, Path

panel_3 = Panel("Launch Full UI")
html_ui = LaunchHTMLUI(HTMLPath=vue_ui.Path, ShowWindow=Toggle(True))  # -> InputValues, InputIds, InputNames, InputTypes
panel_4 = Panel(html_ui.InputNames)
panel_5 = Panel(html_ui.InputValues)
panel_6 = Panel(html_ui.InputIds)
panel_7 = Panel(html_ui.InputTypes)
