# Grasshopper definition ghtest.gh (Grasshopper 1.0.7)
# plug-ins: GHUI

path = FilePath("C:\Users\pmitev\Documents\GitHub\gh-ui\GHUI\Web UI\InputVue.html")
panel = Panel(path)
ghui = GrasshopperUI(HTMLPath=path)  # -> Out, InputIds
panel_2 = Panel(ghui.InputIds)
panel_3 = Panel(ghui.Out)
